# Grasshopper definition find_lot.gh (Grasshopper 1.0.8)

py3 = Python3Script(script=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)  # -> out, all_lot_crvs, road_crvs; unedited script template
panel = Panel(py3.out)
py3_2 = Python3Script(script=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)  # -> out, all_lot_crvs, road_crvs, landlocked_crvs; unedited script template
panel_2 = Panel(py3_2.out)
py3_3 = Python3Script(script=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)  # -> out, all_lot_crvs, road_crvs, flag_lot_crvs; unedited script template
panel_3 = Panel(py3_3.out)
py3_4 = Python3Script(script=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)  # -> out, all_lot_crvs, road_crvs, eligible_block_crvs, ineligible_block_crvs; unedited script template
preview = CustomPreview(
    Geometry=py3_4.ineligible_block_crvs,
    Material={diffuse=RGB(221, 160, 221), emission=RGB(66, 48, 66), shine=0.5, specular=RGB(255, 255, 255), transparency=0})
panel_4 = Panel(py3_4.out)
